# Grasshopper definition first.gh (Grasshopper 1.0.8)

number_slider = Slider(12, range=0..100)
len = Slider(50, range=0..60)
len_2 = Slider(90, range=0..100)
construct_point = ConstructPoint(XCoordinate=0, YCoordinate=0, ZCoordinate=0)
multiplication = Multiplication(A=len_2, B=number_slider)
multiplication_2 = Multiplication(A=len, B=number_slider)
vector_xyz = VectorXYZ(XComponent=multiplication_2, YComponent=multiplication, ZComponent=0)  # -> Vector, Length
point = Point(construct_point)
offset = Slider(6, range=0..9)
move = Move(Geometry=point, Motion=vector_xyz.Vector)  # -> Geometry, Transform
negative = Negative(Value=offset)
rectangle_2pt = Rectangle2Pt(Plane=PlaneXY(0, 0, 0), PointA=point, PointB=move.Geometry, Radius=0)  # -> Rectangle, Length
offset_curve = OffsetCurve(Curve=rectangle_2pt.Rectangle, Distance=negative, Corners=1)
explode = Explode(Curve=offset_curve, Recursive=True)  # -> Segments, Vertices
multiplication_3 = Multiplication(A=Slider(20, range=0..100), B=Slider(12, range=0..100))
list_item = ListItem(List=explode.Segments, Index=0, Wrap=True)
negative_2 = Negative(Value=multiplication_3)
offset_curve_2 = OffsetCurve(Curve=list_item, Distance=negative_2, Corners=1)
multiplication_4 = Multiplication(A=Slider(16, range=0..100), B=Slider(12, range=0..100))
negative_3 = Negative(Value=Slider(9, range=0..100))
negative_4 = Negative(Value=multiplication_4)
offset_curve_3 = OffsetCurve(Curve=offset_curve_2, Distance=negative_3, Corners=1)
end_points = EndPoints(Curve=offset_curve_2)  # -> Start, End
list_item_2 = ListItem(List=explode.Vertices, Index=0, Wrap=True)  # -> Item, Item1
point_2 = Point(end_points.End)
offset_curve_4 = OffsetCurve(Curve=offset_curve_3, Distance=negative_4, Corners=1)
negative_5 = Negative(Value=Slider(6, range=0..100))
line = Line(StartPoint=list_item_2.Item1, EndPoint=point_2)
offset_curve_5 = OffsetCurve(Curve=offset_curve_4, Distance=negative_5, Corners=1)
multiplication_5 = Multiplication(A=Slider(15, range=0..100), B=Slider(12, range=0..100))
negative_6 = Negative(Value=multiplication_5)
offset_curve_6 = OffsetCurve(Curve=line, Distance=negative_6, Corners=1)
negative_7 = Negative(Value=Slider(9, range=0..100))
offset_curve_7 = OffsetCurve(Curve=offset_curve_6, Distance=negative_7, Corners=1)
